# Dynamo graph FindAndReplaceParameters.dyn (Dynamo 1.3.2.2480)

# group: Select an element of the category you would like to Find Replace
select_model_element = DSModelElementSelection()  # 1 picked in the model

getCategory = Element.GetCategory(select_model_element)
all_elements_of_category = ElementsOfCategory(getCategory)

# group: Select Phase of Elements
select_phase = RevitPhases("EFO Suite 136")

byPhaseCreated = Revit.ElementFilter.ByPhaseCreated(all_elements_of_category, select_phase)

# group: Type in Parameter Name
string = StringInput("Panel Name")

watch = Watch(string)
getParameterValueByName = Element.GetParameterValueByName(element=byPhaseCreated, parameterName=watch)

# group: Find and Replace Node. Type in the Strings
string_2 = StringInput("130")
string_3 = StringInput("136")
replace = String.Replace(str=getParameterValueByName, searchFor=string_2, replaceWith=string_3)

setParameterByName = Element.SetParameterByName(element=byPhaseCreated, parameterName=watch, value=replace)
string_4 = StringInput("PHASE BY SUITE")
string_5 = StringInput("Location")
