# Dynamo graph FindPanelByName v1.3.2.dyn (Dynamo 1.3.2.2480)

categories = Categories("ElectricalEquipment")
all_elements_of_category = ElementsOfCategory(categories)
code_block = CodeBlock { "Panel Name"; }
getParameterValueByName = Element.GetParameterValueByName(element=all_elements_of_category, parameterName=code_block)
code_block_2 = CodeBlock { "RHB1"; }
eq = getParameterValueByName == code_block_2
filterByBoolMask = List.FilterByBoolMask(list=all_elements_of_category, mask=eq)
watch = Watch(filterByBoolMask.in)
